# Grasshopper definition Reuse concrete_Hungarian algorithms assignment.gh (Grasshopper 1.0.8)

number_slider = Slider(10, range=0..10)  # disabled
panel = Panel("""0.5*Pi
Pi
1.5*Pi""")
crv = Curve(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)  # disabled
crv_2 = Curve(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)
pop2d = Populate2D(Region=crv, Count=number_slider, Seed=1)  # disabled
# groupA repository
crv_3 = Curve(flatten([<curve referenced from the Rhino model> x10]))
pop2d_2 = Populate2D(Region=crv_2, Count=Slider(10, range=0..10), Seed=1)
area = Area(Geometry=crv_3)  # -> Area, Centroid
rotate = Rotate(Geometry=graft(crv_3), Angle=panel, Plane=graft(area.Centroid))  # -> Geometry, Transform
number_slider_2 = Slider(10, range=0..10)
item = ListItem(List=rotate.Geometry, Index=0, Wrap=True)  # -> flatten(Item), flatten(Item1), flatten(Item2)
voronoi = Voronoi(Points=pop2d, Boundary=crv, BruteForceOverride=False)  # disabled
# groupB target
crv_4 = Curve(voronoi)  # disabled
voronoi_2 = Voronoi(Points=pop2d_2, Boundary=crv_2, BruteForceOverride=False)
# groupB target
crv_5 = Curve(voronoi_2)
# groupA repository
crv_6 = Curve(flatten([<curve referenced from the Rhino model> x10]))  # disabled
crossref = CrossReference(ListA=item.Item, ListB=item.Item1, ListC=item.Item2, CrossMode=5)  # -> ListA, ListB, ListC
# the number of vectors
number_slider_3 = Slider(10, range=0..10)  # disabled
area_2 = Area(Geometry=crv_4)  # -> Area, Centroid; disabled
# the number of vectors
number_slider_4 = Slider(10, range=0..10)
panel_2 = Panel("360")  # disabled
area_3 = Area(Geometry=crv_5)  # -> Area, Centroid
partition = PartitionList(List=crossref.ListA, Size=Slider(10, range=0..10))
branch = TreeBranch(Tree=simplify(partition), MaintainPaths=True)
area_4 = Area(Geometry=crv_6)  # -> Area, Centroid; disabled
division = Division(A=panel_2, B=number_slider_3)  # disabled
area_5 = Area(Geometry=crv_3)  # -> Area, Centroid
X = UnitX(Factor=1)  # disabled
series = Series(Start=0, Step=number_slider_3, Count=division)  # disabled
Z = UnitZ(Factor=1)  # disabled
division_2 = Division(A="360", B=number_slider_4)
X_2 = UnitX(Factor=1)
series_2 = Series(Start=0, Step=number_slider_4, Count=division_2)
Z_2 = UnitZ(Factor=1)
vrot = Rotate(Vector=X, Axis=Z, Angle=degrees(series))  # disabled
vrot_2 = Rotate(Vector=X_2, Axis=Z_2, Angle=degrees(series_2))
X_3 = UnitX(Factor=1)  # disabled
series_3 = Series(Start=0, Step=number_slider_3, Count=division)  # disabled
Z_3 = UnitZ(Factor=1)  # disabled
# increase this if the vector does not intersect with edge
number_slider_5 = Slider(20, range=0..100)  # disabled
X_4 = UnitX(Factor=1)
series_4 = Series(Start=0, Step=number_slider_4, Count=division_2)
Z_4 = UnitZ(Factor=1)
# increase this if the vector does not intersect with edge
number_slider_6 = Slider(20, range=0..100)
vrot_3 = Rotate(Vector=X_3, Axis=Z_3, Angle=degrees(series_3))  # disabled
vrot_4 = Rotate(Vector=X_4, Axis=Z_4, Angle=degrees(series_4))
line = LineSDL(Start=graft(area_4.Centroid), Direction=vrot, Length=number_slider_5)  # disabled
line_2 = LineSDL(Start=graft(area_5.Centroid), Direction=vrot_2, Length=number_slider_6)
ccx = CurveCurve(CurveA=graft(crv_6), CurveB=line)  # -> Points, ParamsA, ParamsB; disabled
ccx_2 = CurveCurve(CurveA=graft(crv_3), CurveB=line_2)  # -> Points, ParamsA, ParamsB
line_3 = LineSDL(Start=graft(area_2.Centroid), Direction=vrot_3, Length=number_slider_5)  # disabled
line_4 = LineSDL(Start=graft(area_3.Centroid), Direction=vrot_4, Length=number_slider_6)
# vectors to all directions
trim = TrimTree(Tree=ccx.Points, Depth=1)  # disabled
# vectors to all directions
trim_2 = TrimTree(Tree=ccx_2.Points, Depth=1)
ccx_3 = CurveCurve(CurveA=graft(crv_4), CurveB=line_3)  # -> Points, ParamsA, ParamsB; disabled
vec2pt = Vector2Pt(PointA=graft(area_4.Centroid), PointB=trim, Unitize=False)  # -> Vector, Length; disabled
ccx_4 = CurveCurve(CurveA=graft(crv_5), CurveB=line_4)  # -> Points, ParamsA, ParamsB
vec2pt_2 = Vector2Pt(PointA=graft(area_5.Centroid), PointB=trim_2, Unitize=False)  # -> Vector, Length
trim_3 = TrimTree(Tree=ccx_3.Points, Depth=1)  # disabled
trim_4 = TrimTree(Tree=ccx_4.Points, Depth=1)
ln = Line(StartPoint=graft(area_4.Centroid), EndPoint=trim)  # disabled
vec2pt_3 = Vector2Pt(PointA=graft(area_2.Centroid), PointB=trim_3, Unitize=False)  # -> Vector, simplify(Length); disabled
ln_2 = Line(StartPoint=graft(area_2.Centroid), EndPoint=trim_3)  # disabled
ln_3 = Line(StartPoint=graft(area_5.Centroid), EndPoint=trim_2)
data = Data(simplify(vec2pt.Length))  # disabled
vec2pt_4 = Vector2Pt(PointA=graft(area_3.Centroid), PointB=trim_4, Unitize=False)  # -> Vector, simplify(Length)
ln_4 = Line(StartPoint=graft(area_3.Centroid), EndPoint=trim_4)
data_2 = Data(simplify(vec2pt_2.Length))
path_mapper = PathMapper(vec2pt_3.Length, source="{a}", target="{a-1}")  # disabled
c_script = CSharpScript(vecLengthA=data, vecLengthB=vec2pt_3.Length)  # -> out, A; inputs vecLengthA: tree of Double, vecLengthB: tree of Double; disabled
# ---------- c_script: C# ----------
    // Create a new DataTree to store the differences
    DataTree<double> differences = new DataTree<double>();

    // Iterate through each branch of vecLengthA
    for (int i = 0; i < vecLengthA.BranchCount; i++)
    {
      // Get the current branch of vecLengthA
      List<double> branchA = vecLengthA.Branch(i);

      // Cross-reference with each branch of vecLengthB
      for (int j = 0; j < vecLengthB.BranchCount; j++)
      {
        // Get the current branch of vecLengthB
        List<double> branchB = vecLengthB.Branch(j);

        // Compare elements in the branches


        if (branchA.Count == branchB.Count)
        {
          // Compare elements in the branches
          for (int k = 0; k < branchA.Count; k++)
          {
            // Calculate the difference between corresponding elements
            double difference = Math.Abs(branchA[k] - branchB[k]);

            // Add the difference to the new DataTree
            GH_Path path = new GH_Path(i, j);  // Set the path for the result tree
            differences.Add(difference, path);
          }
        }

    



      }
    }


    // Set the output
    A = differences;
# ---------- end c_script ----------
path_mapper_2 = PathMapper(vec2pt_4.Length, source="{a}", target="{a-1}")
c_script_2 = CSharpScript(vecLengthA=data_2, vecLengthB=vec2pt_4.Length)  # -> out, A; inputs vecLengthA: tree of Double, vecLengthB: tree of Double; same code as c_script
# The sum of absolute deviations
abs = Absolute(Value=c_script.A)  # disabled
# The sum of absolute deviations
abs_2 = Absolute(Value=c_script_2.A)
# create a Matrix: sum of deviation against index of group B
ma = MassAddition(Input=abs)  # -> simplify(Result), PartialResults; disabled
# create a Matrix: sum of deviation against index of group B
ma_2 = MassAddition(Input=abs_2)  # -> simplify(Result), PartialResults
trim_5 = TrimTree(Tree=ma.Result, Depth=1)  # disabled
trim_6 = TrimTree(Tree=ma_2.Result, Depth=1)
int = Integer(trim_5)  # disabled
int_2 = Integer(trim_6)
hungarianassignment = CSharpScript(costMatrix=int)  # -> out, A, xIndices; inputs costMatrix: tree of Int32; disabled
# ---------- hungarianassignment: C# usings ----------
using System.IO;
using System.Linq;
using System.Data;
using System.Drawing;
using System.Reflection;
using System.Windows.Forms;
using System.Xml;
using System.Xml.Linq;
using System.Runtime.InteropServices;

using Rhino.DocObjects;
using Rhino.Collections;
using GH_IO;
using GH_IO.Serialization;
# ---------- hungarianassignment: C# ----------
    int[,] CM = new int[costMatrix.BranchCount, costMatrix.Branch(0).Count];

    for(int i = 0; i < costMatrix.BranchCount;i++)
    {
      for (int j = 0; j < costMatrix.Branch(i).Count;j++)
      {
        CM[i, j] = costMatrix.Branch(i)[j];

      }
    }
    HungarianAlgorithm HA = new HungarianAlgorithm(CM);

    xIndices = HA.Run();
# ---------- hungarianassignment: C# additional code ----------
  /*
  C# hungarian algorithm implementation
  Copyright (C) 2015  Ivan Jurin

  This program is free software; you can redistribute it and/or modify
  it under the terms of the GNU General Public License as published by
  the Free Software Foundation; either version 2 of the License, or
  (at your option) any later version.

  This program is distributed in the hope that it will be useful,
  but WITHOUT ANY WARRANTY; without even the implied warranty of
  MERCHANTABILITY or FITNESS FOR A PARTICULAR PURPOSE.  See the
  GNU General Public License for more details.

  You should have received a copy of the GNU General Public License along
  with this program; if not, write to the Free Software Foundation, Inc.,
  51 Franklin Street, Fifth Floor, Boston, MA 02110-1301 USA.
  */


  public sealed class HungarianAlgorithm
  {
    private readonly int[,] _costMatrix;
    private int _inf;
    private int _n; //number of elements
    private int[] _lx; //labels for workers
    private int[] _ly; //labels for jobs
    private bool[] _s;
    private bool[] _t;
    private int[] _matchX; //vertex matched with x
    private int[] _matchY; //vertex matched with y
    private int _maxMatch;
    private int[] _slack;
    private int[] _slackx;
    private int[] _prev; //memorizing paths

    /// <summary>
    ///
    /// </summary>
    /// <param name="costMatrix"></param>
    public HungarianAlgorithm(int[,] costMatrix)
    {
      _costMatrix = costMatrix;
    }

    /// <summary>
    ///
    /// </summary>
    /// <returns></returns>
    public int[] Run()
    {
      _n = _costMatrix.GetLength(0);

      _lx = new int[_n];
      _ly = new int[_n];
      _s = new bool[_n];
      _t = new bool[_n];
      _matchX = new int[_n];
      _matchY = new int[_n];
      _slack = new int[_n];
      _slackx = new int[_n];
      _prev = new int[_n];
      _inf = int.MaxValue;


      InitMatches();

      if (_n != _costMatrix.GetLength(1))
        return null;

      InitLbls();

      _maxMatch = 0;

      InitialMatching();

      var q = new Queue<int>();

      #region augment

      while (_maxMatch != _n)
      {
        q.Clear();

        InitSt();
        //Array.Clear(S,0,n);
        //Array.Clear(T, 0, n);


        //parameters for keeping the position of root node and two other nodes
        var root = 0;
        int x;
        var y = 0;

        //find root of the tree
        for (x = 0; x < _n; x++)
        {
          if (_matchX[x] != -1) continue;
          q.Enqueue(x);
          root = x;
          _prev[x] = -2;

          _s[x] = true;
          break;
        }

        //init slack
        for (var i = 0; i < _n; i++)
        {
          _slack[i] = _costMatrix[root, i] - _lx[root] - _ly[i];
          _slackx[i] = root;
        }

        //finding augmenting path
        while (true)
        {
          while (q.Count != 0)
          {
            x = q.Dequeue();
            var lxx = _lx[x];
            for (y = 0; y < _n; y++)
            {
              if (_costMatrix[x, y] != lxx + _ly[y] || _t[y]) continue;
              if (_matchY[y] == -1) break; //augmenting path found!
              _t[y] = true;
              q.Enqueue(_matchY[y]);

              AddToTree(_matchY[y], x);
            }
            if (y < _n) break; //augmenting path found!
          }
          if (y < _n) break; //augmenting path found!
          UpdateLabels(); //augmenting path not found, update labels

          for (y = 0; y < _n; y++)
          {
            //in this cycle we add edges that were added to the equality graph as a
            //result of improving the labeling, we add edge (slackx[y], y) to the tree if
            //and only if !T[y] &&  slack[y] == 0, also with this edge we add another one
            //(y, yx[y]) or augment the matching, if y was exposed

            if (_t[y] || _slack[y] != 0) continue;
            if (_matchY[y] == -1) //found exposed vertex-augmenting path exists
            {
              x = _slackx[y];
              break;
            }
            _t[y] = true;
            if (_s[_matchY[y]]) continue;
            q.Enqueue(_matchY[y]);
            AddToTree(_matchY[y], _slackx[y]);
          }
          if (y < _n) break;
        }

        _maxMatch++;

        //inverse edges along the augmenting path
        int ty;
        for (int cx = x, cy = y; cx != -2; cx = _prev[cx], cy = ty)
        {
          ty = _matchX[cx];
          _matchY[cy] = cx;
          _matchX[cx] = cy;
        }
      }

      #endregion

      return _matchX;
    }

    private void InitMatches()
    {
      for (var i = 0; i < _n; i++)
      {
        _matchX[i] = -1;
        _matchY[i] = -1;
      }
    }

    private void InitSt()
    {
      for (var i = 0; i < _n; i++)
      {
        _s[i] = false;
        _t[i] = false;
      }
    }

    private void InitLbls()
    {
      for (var i = 0; i < _n; i++)
      {
        var minRow = _costMatrix[i, 0];
        for (var j = 0; j < _n; j++)
        {
          if (_costMatrix[i, j] < minRow) minRow = _costMatrix[i, j];
          if (minRow == 0) break;
        }
        _lx[i] = minRow;
      }
      for (var j = 0; j < _n; j++)
      {
        var minColumn = _costMatrix[0, j] - _lx[0];
        for (var i = 0; i < _n; i++)
        {
          if (_costMatrix[i, j] - _lx[i] < minColumn) minColumn = _costMatrix[i, j] - _lx[i];
          if (minColumn == 0) break;
        }
        _ly[j] = minColumn;
      }
    }

    private void UpdateLabels()
    {
      var delta = _inf;
      for (var i = 0; i < _n; i++)
        if (!_t[i])
          if(delta > _slack[i])
            delta = _slack[i];
      for (var i = 0; i < _n; i++)
      {
        if (_s[i])
          _lx[i] = _lx[i] + delta;
        if (_t[i])
          _ly[i] = _ly[i] - delta;
        else _slack[i] = _slack[i] - delta;
      }
    }

    private void AddToTree(int x, int prevx)
    {
      //x-current vertex, prevx-vertex from x before x in the alternating path,
      //so we are adding edges (prevx, matchX[x]), (matchX[x],x)

      _s[x] = true; //adding x to S
      _prev[x] = prevx;

      var lxx = _lx[x];
      //updateing slack
      for (var y = 0; y < _n; y++)
      {
        if (_costMatrix[x, y] - lxx - _ly[y] >= _slack[y]) continue;
        _slack[y] = _costMatrix[x, y] - lxx - _ly[y];
        _slackx[y] = x;
      }
    }

    private void InitialMatching()
    {
      for (var x = 0; x < _n; x++)
      {
        for (var y = 0; y < _n; y++)
        {
          if (_costMatrix[x, y] != _lx[x] + _ly[y] || _matchY[y] != -1) continue;
          _matchX[x] = y;
          _matchY[y] = x;
          _maxMatch++;
          break;
        }
      }
    }
    
  }
# ---------- end hungarianassignment ----------
hungarianassignment_2 = CSharpScript(costMatrix=int_2)  # -> out, A, xIndices; inputs costMatrix: tree of Int32; same code as hungarianassignment
# rearrange groupB
item_2 = ListItem(List=flatten(crv_4), Index=hungarianassignment.xIndices, Wrap=True)  # disabled
# rearrange groupB
item_3 = ListItem(List=flatten(crv_5), Index=hungarianassignment_2.xIndices, Wrap=True)
int_3 = Integer(hungarianassignment.xIndices)  # disabled
int_4 = Integer(hungarianassignment_2.xIndices)
area_6 = Area(Geometry=item_2)  # -> Area, Centroid; disabled
area_7 = Area(Geometry=item_3)  # -> Area, Centroid
area_8 = Area(Geometry=crv_6)  # -> Area, Centroid; disabled
area_9 = Area(Geometry=crv_3)  # -> Area, Centroid
# match A to B
ln_5 = Line(StartPoint=area_8.Centroid, EndPoint=area_6.Centroid)  # disabled
# match A to B
ln_6 = Line(StartPoint=area_9.Centroid, EndPoint=area_7.Centroid)
move = Move(Geometry=crv_6, Motion=ln_5)  # -> Geometry, Transform; disabled
move_2 = Move(Geometry=crv_3, Motion=ln_6)  # -> Geometry, Transform
